# Grasshopper definition sunlight_moukachar.gh (Grasshopper 0.9.76)
# plug-ins: Python Interpreter

number_slider = Slider(5.5, range=0..10)
xy = XYPlane(Origin=Point(0, 0, 0))
xy_2 = XYPlane(Origin=Point(0, 0, 0))
square = PythonScript(plane=xy)  # -> out, sqr; inputs plane: Plane
# ---------- square: Python ----------
#Square module
import rhinoscriptsyntax as rs

if lado == None: lado = 5.00
#if plane == None: plane = UV

class Quadrado():
    ###Define um quadrado###

    def __init__(self, lado):
        self.lado = lado
        print(lado)

    def calculaArea(self):
        area = self.lado * self.lado
        print('area = %d' %area)

    def createrSqr(self):
        shape = rs.AddRectangle(plane, self.lado, self.lado)
        return shape



"""
    def método para preencher ou não o objeto:
        if == True:
            preencher
        else:
            não preencher

    # Define método para alterar default (ñ funciona)
    def setX(self, new_lado):
        self.lado = new_lado

    def getX(self):
        return self.lado
"""


#cria a instância quadrado
quadrado = Quadrado(lado)

quadrado.calculaArea()
sqr = quadrado.createrSqr()
# ---------- end square ----------
square_2 = PythonScript(plane=xy_2)  # -> out, sqr; inputs plane: Plane
# ---------- square_2: Python ----------
#Square module
import rhinoscriptsyntax as rs

#if lado == None: lado = 5.00
#if plane == None: plane = UV

class Quadrado():
    ###Define um quadrado###

    def __init__(self, testada, profundidade):
        self.testada = testada
        self.profundidade = profundidade
        print("Criando terreno de %d por %d" % (self.testada, self.profundidade))

    def createrSqr(self):
        shape = rs.AddRectangle(plane, self.testada, self.profundidade)
        return shape
 

#cria a instância quadrado
quadrado = Quadrado(12,30)


sqr = quadrado.createrSqr()
# ---------- end square_2 ----------
panel = Panel(square.out)
srf = Surface(square.sqr)
panel_2 = Panel(square_2.out)
srf_2 = Surface(square_2.sqr)
Y = UnitY(Factor=Slider(30, range=0..100))
X = UnitX(Factor=Slider(-12, range=-12..100))
X_2 = UnitX(Factor=Slider(12, range=0..100))
move = Move(Geometry=srf_2, Motion=Y)  # -> Geometry, Transform
move_2 = Move(Geometry=srf_2, Motion=X)  # -> Geometry, Transform
move_3 = Move(Geometry=srf_2, Motion=X_2)  # -> Geometry, Transform
reference = Panel("https://medium.com/generative-design/solar-analysis-in-grasshopper-5dae76c9b6cb")
# 18°56'11.7"S 48°15'49.9"W
# 
# latitude e longitude expresso em graus decimais
# 
# -18.936490
# -48.263842
panel_3 = Panel("1 to 12")
number_slider_2 = Slider(42, range=0..60)
range = Range(Domain="9 to 16", Steps="4")
range_2 = Range(Domain=panel_3, Steps="4")
number_slider_3 = Slider(200, range=0..1000)
latitude = Panel("-18.936490")
longitude = Panel("-48.263842")

# ---- group: originais
latitude_2 = Panel("40.7128")
longitude_2 = Panel("74.0059")

# ---- group: tower form
python = PythonScript(
    area=Slider(2000, range=0..3000),
    ratio=Slider(0.25, range=0.2..0.8),
    height=Slider(300, range=0..500),
    angle=Slider(90, range=-1..180),
    panelWidth=Slider(5, range=5..15))  # -> out, panels
# ---------- python: Python ----------
import Rhino.Geometry as rh
import rhinoscriptsyntax as rs
import math

angle = angle * (math.pi/180.0)

up = rh.Vector3d(0,0,1)
origin = rh.Point3d(0,0,0)

dim = ( area / ( ratio - ratio ** 2 )) ** 0.5

length = dim * ratio
width = dim * (1 - ratio)

floor_to_floor = 12

floors = int(math.floor(height / floor_to_floor))

increment = angle / float(floors)

floor_curves = []
edge_points = []

for floor in range(floors):
    edge_points.append([])
    
    rec = rh.Rectangle3d(rh.Plane(rh.Point3d(-length/2,-width/2,0), up), length, width)
    rec.Transform(rh.Transform.Rotation(increment * floor, up, origin))
    rec.Transform(rh.Transform.Translation(0, 0, floor_to_floor * floor))
    
    edges = [rs.coercecurve(edge) for edge in rs.ExplodeCurves(rec.ToNurbsCurve())]
    
    for edge in edges:
        len = edge.GetLength()
        numPanel = round(len/panelWidth)
        
        pointParams = edge.DivideByCount(numPanel, True)
        
        for param in pointParams:
            edge_points[-1].append(edge.PointAt(param))
    
    floor_curves.append(rec.ToNurbsCurve())

panels = []

for i, floor_points in enumerate(edge_points[:-1]):
    for j, pt1 in enumerate(floor_points[:-1]):
        
        pt2 = edge_points[i][j+1]
        pt3 = edge_points[i+1][j+1]
        pt4 = edge_points[i+1][j]
        
        panel = rs.AddSrfPt([pt1, pt2, pt3, pt4])
        
        if panel is not None:
            panels.append(rs.AddSrfPt([pt1, pt2, pt3, pt4]))
# ---------- end python ----------

# ---- group: Árvores
pt = ConstructPoint(XCoordinate=2.4, YCoordinate=0.45, ZCoordinate=Slider(7, range=0..100))
pt_2 = ConstructPoint(XCoordinate=3.6, YCoordinate=1.2, ZCoordinate=Slider(10, range=0..100))
sph = Sphere(Base=pt_2, Radius=6)
sph_2 = Sphere(Base=pt, Radius=5)

# ---- group: sun position calculator
X_3 = UnitX(Factor=1)
Z = UnitZ(Factor=1)
sun_angles = CSharpScript(
    GMT=Slider(5, range=0..23),
    Hour=range,
    DayOfMonth=Slider(1, range=0..31),
    Month=range_2,
    Year=Slider(2012, range=1970..2050),
    Latitude=latitude,
    Longitude=longitude,
    North=X_3,
    Up=Z,
    DataComparison="cross_reference")  # -> out, azimuth, altitude, direction; inputs GMT: Int32, Hour: Int32, DayOfMonth: Int32, Month: Int32, Year: Int32, Latitude: Double, Longitude: Double, North: Vector3d, Up: Vector3d
# ---------- sun_angles: C# ----------
    // Implementation in C# by Mikael Nillsson
    // http://guideving.blogspot.nl/2010/08/sun-position-in-c.html
    // Adaptation to Grasshopper By Arend van Waart <Arendvw@gmail.com>
    // @see http://stackoverflow.com/questions/8708048/position-of-the-sun-given-time-of-day-latitude-and-longitude

    North.Unitize();
    Up.Unitize();


    DateTime time = new DateTime(Year, Month, DayOfMonth, Hour, 0, 0, DateTimeKind.Utc);
    time = time.AddHours(-GMT);
    this.CalculateSunPosition(time, Latitude, Longitude);
    azimuth = this.azimuth;
    altitude = this.altitude;

    // plane: x = north; y = up
    Point3d p0 = new Point3d(0, 0, 0);
    Point3d p1 = new Point3d(1, 0, 0);
    p1.Transform(Transform.Translation(North));
    p1.Transform(Transform.Rotation(this.azimuth, Up, p0));

    Plane azPlane = new Plane(p0, new Vector3d(p1), Up);
    p1.Transform(Transform.Rotation(this.altitude, azPlane.ZAxis, p0));
    Vector3d dir = new Vector3d(p1);
    dir.Unitize();
    direction = dir;
# ---------- sun_angles: C# additional code ----------
  private const double Deg2Rad = Math.PI / 180.0;
  private const double Rad2Deg = 180.0 / Math.PI;
  private double altitude;
  private double azimuth;

    /*!
     * \brief Calculates the sun light.
     *
     * CalcSunPosition calculates the suns "position" based on a
     * given date and time in local time, latitude and longitude
     * expressed in decimal degrees. It is based on the method
     * found here:
     * http://www.astro.uio.no/~bgranslo/aares/calculate.html
     * The calculation is only satisfiably correct for dates in
     * the range March 1 1900 to February 28 2100.
     * \param dateTime Time and date in local time.
     * \param latitude Latitude expressed in decimal degrees.
     * \param longitude Longitude expressed in decimal degrees.
     */
  public void CalculateSunPosition(
    DateTime dateTime, double latitude, double longitude)
  {
    // Convert to UTC
    dateTime = dateTime.ToUniversalTime();

    // Number of days from J2000.0.
    double julianDate = 367 * dateTime.Year -
      (int) ((7.0 / 4.0) * (dateTime.Year +
      (int) ((dateTime.Month + 9.0) / 12.0))) +
      (int) ((275.0 * dateTime.Month) / 9.0) +
      dateTime.Day - 730531.5;

    double julianCenturies = julianDate / 36525.0;

    // Sidereal Time
    double siderealTimeHours = 6.6974 + 2400.0513 * julianCenturies;

    double siderealTimeUT = siderealTimeHours +
      (366.2422 / 365.2422) * (double) dateTime.TimeOfDay.TotalHours;

    double siderealTime = siderealTimeUT * 15 + longitude;

    // Refine to number of days (fractional) to specific time.
    julianDate += (double) dateTime.TimeOfDay.TotalHours / 24.0;
    julianCenturies = julianDate / 36525.0;

    // Solar Coordinates
    double meanLongitude = CorrectAngle(Deg2Rad *
      (280.466 + 36000.77 * julianCenturies));

    double meanAnomaly = CorrectAngle(Deg2Rad *
      (357.529 + 35999.05 * julianCenturies));

    double equationOfCenter = Deg2Rad * ((1.915 - 0.005 * julianCenturies) *
      Math.Sin(meanAnomaly) + 0.02 * Math.Sin(2 * meanAnomaly));

    double elipticalLongitude =
      CorrectAngle(meanLongitude + equationOfCenter);

    double obliquity = (23.439 - 0.013 * julianCenturies) * Deg2Rad;

    // Right Ascension
    double rightAscension = Math.Atan2(
      Math.Cos(obliquity) * Math.Sin(elipticalLongitude),
      Math.Cos(elipticalLongitude));

    double declination = Math.Asin(
      Math.Sin(rightAscension) * Math.Sin(obliquity));

    // Horizontal Coordinates
    double hourAngle = CorrectAngle(siderealTime * Deg2Rad) - rightAscension;

    if (hourAngle > Math.PI)
    {
      hourAngle -= 2 * Math.PI;
    }

    this.altitude = Math.Asin(Math.Sin(latitude * Deg2Rad) *
      Math.Sin(declination) + Math.Cos(latitude * Deg2Rad) *
      Math.Cos(declination) * Math.Cos(hourAngle));

    // Nominator and denominator for calculating Azimuth
    // angle. Needed to test which quadrant the angle is in.
    double aziNom = -Math.Sin(hourAngle);
    double aziDenom =
      Math.Tan(declination) * Math.Cos(latitude * Deg2Rad) -
      Math.Sin(latitude * Deg2Rad) * Math.Cos(hourAngle);

    this.azimuth = Math.Atan(aziNom / aziDenom);

    if (aziDenom < 0) // In 2nd or 3rd quadrant
    {
      this.azimuth += Math.PI;
    }
    else if (aziNom < 0) // In 4th quadrant
    {
      this.azimuth += 2 * Math.PI;
    }

    // Altitude
    //Console.WriteLine("Altitude: " + altitude * Rad2Deg);

    // Azimut
    //Console.WriteLine("Azimuth: " + azimuth * Rad2Deg);
  }

    /*!
    * \brief Corrects an angle.
    *
    * \param angleInRadians An angle expressed in radians.
    * \return An angle in the range 0 to 2*PI.
    */
  private static double CorrectAngle(double angleInRadians)
  {
    if (angleInRadians < 0)
    {
      return 2 * Math.PI - (Math.Abs(angleInRadians) % (2 * Math.PI));
    }
    else if (angleInRadians > 2 * Math.PI)
    {
      return angleInRadians % (2 * Math.PI);
    }
    else
    {
      return angleInRadians;
    }
  }
# ---------- end sun_angles ----------

# ----
pt_3 = ConstructPoint(XCoordinate=0, YCoordinate=0, ZCoordinate=0)
pt_4 = ConstructPoint(XCoordinate=12, YCoordinate=0, ZCoordinate=0)
pt_5 = ConstructPoint(XCoordinate=12, YCoordinate=30, ZCoordinate=0)
pt_6 = ConstructPoint(XCoordinate=0, YCoordinate=30, ZCoordinate=0)
number_slider_4 = Slider(40, range=0..270)

# ---- group: park area
pt_7 = ConstructPoint(XCoordinate="25", YCoordinate="-40", ZCoordinate=0)
rectangle = Rectangle(Plane=pt_7, XSize="150", YSize="100", Radius=0)  # -> Rectangle, Length

# ----
pt_8 = ConstructPoint(XCoordinate=0, YCoordinate=0, ZCoordinate=0)
pt_9 = ConstructPoint(XCoordinate=0, YCoordinate=number_slider_3, ZCoordinate=0)
pt_10 = ConstructPoint(XCoordinate=number_slider_3, YCoordinate=number_slider_3, ZCoordinate=number_slider_2)
pt_11 = ConstructPoint(XCoordinate=number_slider_3, YCoordinate=0, ZCoordinate=number_slider_2)
srf4pt = _4PointSurface(CornerA=pt_3, CornerB=pt_4, CornerC=pt_5, CornerD=pt_6)
srf4pt_2 = _4PointSurface(CornerA=pt_8, CornerB=pt_9, CornerC=pt_10, CornerD=pt_11)
area = Area(Geometry=srf4pt_2)  # -> Area, Centroid

# ---- group: lote
srf_3 = Surface(srf4pt)

# ---- group: lotes vizinhos
X_4 = UnitX(Factor=12)
X_5 = UnitX(Factor=-12)
Y_2 = UnitY(Factor=30)
move_4 = Move(Geometry=srf_3, Motion=X_4)  # -> Geometry, Transform
move_5 = Move(Geometry=srf_3, Motion=X_5)  # -> Geometry, Transform
move_6 = Move(Geometry=srf_3, Motion=Y_2)  # -> Geometry, Transform

# ----
join = BrepJoin(Breps=python.panels)  # -> Breps, Closed
rot3d = Rotate3D(Geometry=srf4pt_2, Angle=degrees(number_slider_4), Center=area.Centroid, Axis=Vector(0, 0, 1))  # -> Geometry, Transform
rot3d_2 = Rotate3D(Geometry=srf4pt_2, Angle=degrees(number_slider_4), Center=area.Centroid, Axis=Vector(0, 0, 1))  # -> Geometry, Transform
mesh_uv = MeshSurface(Surface=rectangle.Rectangle, UCount="10", VCount="10", Overhang=True, Equalize=False)
mesh_uv_2 = MeshSurface(Surface=python.panels, UCount="1", VCount="1", Overhang=True, Equalize=False)
cap = CapHoles(Brep=join.Breps)
preview = CustomPreview(Geometry=[move_4.Geometry, move_5.Geometry, move_6.Geometry], Shader=ColourSwatch(SwatchColor=RGBA(190, 191, 189, 137)))
preview_2 = CustomPreview(Geometry=sph_2, Shader=ColourSwatch(SwatchColor=RGBA(167, 227, 107, 137)))
preview_3 = CustomPreview(Geometry=sph, Shader=ColourSwatch(SwatchColor=RGBA(72, 117, 26, 137)))
demesh = DeconstructMesh(Mesh=mesh_uv)  # -> Vertices, Faces, Colours, Normals
rev = Reverse(Vector=sun_angles.direction)
facen = FaceNormals(Mesh=mesh_uv_2)  # -> Centers, simplify(Normals)
demesh_2 = DeconstructMesh(Mesh=mesh_uv_2)  # -> Vertices, Faces, Colours, Normals
sun_viz = _sunViz(V=sun_angles.direction, num="250")  # -> L, S
mesh = Mesh(cap)
angle = Angle(VectorA=sun_angles.direction, VectorB=facen.Normals)  # -> Angle, Reflex
occ = Occlusion(Samples=demesh.Vertices, Obstructions=mesh, Rays=rev)  # -> Hits, Occlusion
cos = Cosine(Value=angle.Angle)
bnd = Bounds(Numbers=occ.Hits)
python_2 = PythonScript(Code="a = max(0, x)", X=cos)  # -> Out, A
dedomain = DeconstructDomain(Domain=bnd)  # -> Start, End
bnd_2 = Bounds(Numbers=python_2.A)
gradient = Gradient(LowerLimit=dedomain.Start, UpperLimit=dedomain.End, Parameter=occ.Hits, stops=[0: RGB(255, 255, 255), 1: RGB(0, 0, 0)])
dedomain_2 = DeconstructDomain(Domain=bnd_2)  # -> Start, End
gradient_2 = Gradient(
    LowerLimit=0,
    UpperLimit=1,
    Parameter=dedomain_2.End,
    stops=[0: RGB(224, 224, 224), 0.54: RGB(255, 255, 0), 1: RGB(255, 0, 0)])
ma = MassAddition(Input=flatten(dedomain_2.End))  # -> Result, PartialResults
ma_2 = MassAddition(Input=occ.Hits)  # -> Result, PartialResults
conmesh = ConstructMesh(Vertices=demesh.Vertices, Faces=demesh.Faces, Colours=gradient)
total_occlussion_minimize = Panel(ma_2.Result)
total_maximum_insolation_minimize = Panel(ma.Result)
conmesh_2 = ConstructMesh(Vertices=demesh_2.Vertices, Faces=demesh_2.Faces, Colours=gradient_2)

# ==== cluster _sunViz
V = ClusterInput()
num = ClusterInput()
num_2 = Number(num)
pt = ConstructPoint(XCoordinate=0, YCoordinate=0, ZCoordinate=0)
amp = Amplitude(Vector=V, Amplitude=num_2)
move = Move(Geometry=pt, Motion=amp)  # -> Geometry, Transform
division = Division(A=num_2, B="40")
sph = Sphere(Base=move.Geometry, Radius=division)
ln = Line(StartPoint=pt, EndPoint=move.Geometry)
L = ClusterOutput(ln)
S = ClusterOutput(sph)
